# Grasshopper definition mobius.gh (Grasshopper 0.9.76)
# plug-ins: Biomorpher, MeshEdit Components, LunchBox, Weaverbird

number_slider = Slider(4, range=0..5)
mobius = MobiusSurface(
    UDivisions=100,
    VDivisions=100,
    RParameter=4,
    TParameter=number_slider,
    Scale=5,
    Domain1=Domain(-3.141592654, 3.141592654),
    Domain2=Domain(-1, 1))
genes = GenePool(Decimals=2, Maximum=20, Minimum=0, Value=[4.87, 9.85])
number_slider_2 = Slider(4.7, range=0..10)
item = ListItem(List=genes, Index=0, Wrap=True)  # -> Item, Item1
hex = HexagonCells(Surface=mobius, UDivisions=item.Item, VDivisions=item.Item1, TParameter=0.25)  # -> HexagonCells, Centers
wbframe = WeaverbirdsPictureFrame(MeshPolylines=hex.HexagonCells, Distance=5, InsetType=0)
wbthicken = WeaverbirdsMeshThicken(MeshCurves=wbframe, Distance=number_slider_2, OffsetType=0)
area = MeshArea(Mesh=wbthicken)  # -> Area, Centroid
biomorpher = Biomorpher(
    Sliders=[number_slider_2, number_slider, Slider(8, range=2..10), Slider(49, range=29..100), genes],
    Geometry=wbthicken,
    Performas=area.Area)
